% Simulink design studies TorqueSweepDesignStudy.mldatx for model QuadcopterElectromechanics

study "Torque Sweep": 13 simulations
  combinatorial set (13 points):
    "Block Parameter_1": BlockParameter(BlockPath=QuadcopterElectromechanics/Torque Command, Name=constant), values 0:0.1:1.2 (13 points)